% Requirement links of graph_unit_tests.m (R2024a)

% line 1 relates to shortest_path_tests_reqs.slreqx#1
classdef graph_unit_tests < matlab.unittest.TestCase

% line 4 verifies shortest_path_tests_reqs.slreqx#14
% line 4 verifies shortest_path_func_reqs.slreqx#7
        function check_invalid_start_1(testCase)

% line 12 verifies shortest_path_tests_reqs.slreqx#18
% line 12 verifies shortest_path_func_reqs.slreqx#6
        function check_invalid_start_2(testCase)

% line 20 verifies shortest_path_tests_reqs.slreqx#21
% line 20 verifies shortest_path_func_reqs.slreqx#7
        function check_invalid_end_1(testCase)

% line 28 verifies shortest_path_tests_reqs.slreqx#20
% line 28 verifies shortest_path_func_reqs.slreqx#6
        function check_invalid_end_2(testCase)

% line 36 verifies shortest_path_tests_reqs.slreqx#4
% line 36 verifies shortest_path_tests_reqs.slreqx#6
% line 36 verifies shortest_path_func_reqs.slreqx#3
        function check_longest_path(testCase)

% line 44 verifies shortest_path_tests_reqs.slreqx#8
% line 44 verifies shortest_path_func_reqs.slreqx#3
        function check_unity_path(testCase)

% line 52 verifies shortest_path_tests_reqs.slreqx#3
% line 52 verifies shortest_path_tests_reqs.slreqx#5
        function check_non_unique(testCase)

% line 60 verifies shortest_path_func_reqs.slreqx#4
        function check_no_path(testCase)

% line 68 verifies shortest_path_tests_reqs.slreqx#10
% line 68 verifies shortest_path_func_reqs.slreqx#4
        function check_edgeless_graph(testCase)

% line 76 verifies shortest_path_tests_reqs.slreqx#12
% line 76 verifies shortest_path_func_reqs.slreqx#4
        function check_edgeless_start(testCase)

% line 84 verifies shortest_path_tests_reqs.slreqx#13
% line 84 verifies shortest_path_func_reqs.slreqx#4
        function check_edgeless_end(testCase)

% line 93 verifies shortest_path_func_reqs.slreqx#5
        function check_edgeless_graph_self_loop(testCase)

% line 101 verifies shortest_path_func_reqs.slreqx#5
        function check_start_end_same(testCase)

% line 109 verifies shortest_path_tests_reqs.slreqx#11
        function check_invalid_idx_empty_adj(testCase)